# Grasshopper definition RobArch_localization_cleaned.ghx (Grasshopper 1.0.7)
# plug-ins: Pufferfish

panel = Panel("Unload libraries")
# LOCALIZATION
reload = Button()
py = PythonScript(reload=reload)
# ---------- py: Python ----------
from compas_ghpython import unload_modules

if reload:
    unload_modules("mobile_robot_control")
# ---------- end py ----------

# ----
# DESIGN VISUALIZATION
# generic_assembly
panel_2 = Panel("C:\Users\eleni\Dropbox\00_DFAB\03_THESIS\08_RobArch\json_data\robarch24_assembly_graph_no_attr.json")
python = GhPythonScript(filepath=panel_2)  # -> out, assembly_out
# ---------- python: Python ----------
from compas.data import json_load, json_dump
from compas.datastructures import Assembly, Graph
import json


assembly = Assembly()

data = json_load(filepath)
assembly_data = data["assembly"]
graph = Graph.__from_data__(assembly_data["graph"])
assembly.graph = graph

assembly_out = assembly
# ---------- end python ----------

aruco_marker_size = Panel("0.070")
gutter = Panel("0.003")
margin = Panel("0.0035")

py_2 = PythonScript()  # -> ENVIRONMENT_NAME, HERE, DATA
# ---------- py_2: Python ----------
import os
import compas_bootstrapper

HERE = os.path.dirname(ghdoc.Path)
DATA = os.path.abspath(os.path.join(HERE, "..", "data"))
ENVIRONMENT_NAME = compas_bootstrapper.ENVIRONMENT_NAME
print(HERE)
print(DATA)
print(ENVIRONMENT_NAME)
# ---------- end py_2 ----------
panel_3 = Panel(py_2.ENVIRONMENT_NAME)

origin_point = Point()
y_point = Point()
x_point = Point()

# ----
# Create QR Frame From Points
center_frame = GhPythonScript(origin_point=origin_point, x_point=x_point, y_point=y_point)  # -> out, qr_plane; inputs origin_point: Point3d, x_point: Point3d, y_point: Point3d
# ---------- center_frame: Python ----------
import Rhino.Geometry as rg
from compas_rhino.conversions import plane_to_compas_frame


if not (origin_point or x_point or y_point):
    ghenv.Component.Message = "Missing a Point"
else:
    ghenv.Component.Message = None
    # Calculate midpoints along x-axis and y-axis separately
    midpoint_x = rg.Point3d((origin_point.X + x_point.X) / 2,
                            (origin_point.Y + x_point.Y) / 2,
                            (origin_point.Z + x_point.Z) / 2)
    midpoint_y = rg.Point3d((origin_point.X + y_point.X) / 2,
                            (origin_point.Y + y_point.Y) / 2,
                            (origin_point.Z + y_point.Z) / 2)
    
    plane = rg.Plane(origin_point, x_point, y_point)
    original_plane = rg.Plane(origin_point, x_point, y_point)
    # Calculate the translation vectors
    x_translation_vector = rg.Vector3d(plane.XAxis) * origin_point.DistanceTo(midpoint_x)
    y_translation_vector = rg.Vector3d(plane.YAxis) * origin_point.DistanceTo(midpoint_y)
    plane.Translate(x_translation_vector)
    plane.Translate(y_translation_vector)
    
    qr_frame = plane_to_compas_frame(plane)
    qr_plane = plane
# ---------- end center_frame ----------

# ----
# Internalize this plane and every next before uploading to Firebase
plane = Plane(center_frame.qr_plane)

# ----
# Define a Plane in Rhino
angle = Slider(0, range=0..360)
base_origin = Point(Point(-0.06489286496, 0.5802834359, 0))
base_plane = GhPythonScript(origin=base_origin, angle=angle)  # -> base_plane; inputs origin: Point3d
# ---------- base_plane: Python ----------
import Rhino.Geometry as rg
import math

base_plane = rg.Plane(origin, rg.Vector3d.XAxis, rg.Vector3d.YAxis)
base_plane.Rotate(math.radians(angle), rg.Vector3d.ZAxis)
# ---------- end base_plane ----------

# ----
# CONNECT AND ADJUST ROBOT'S POSITION
# 1) Load robot from ROS
panel_4 = Panel("192.168.131.22")
connect = BooleanToggle(True)
ros = COMPASFABROSConnect(ip=panel_4, port="9090", connect=connect)  # -> ros_client, is_connected; inputs port: Int32, connect: Boolean
#   port ip: The ip address ROS. Defaults to 127.0.0.1.
#   port port: The port of ROS. Defaults to 9090.
#   port connect: If True, connects to ROS. If False, disconnects from ROS. Defaults to False.
#   port ros_client: The ROS client.
#   port is_connected: True if connection established.
# ---------- ros: Python ----------
"""
Connect or disconnect to ROS.

COMPAS FAB v1.0.2
"""

from ghpythonlib.componentbase import executingcomponent as component
from scriptcontext import sticky as st

from compas_fab.backends import RosClient
from compas_fab.ghpython.components import create_id


class ROSConnect(component):
    def RunScript(self, ip, port, connect):
        ros_client = None

        ip = ip or "127.0.0.1"
        port = port or 9090

        key = create_id(self, "ros_client")
        ros_client = st.get(key, None)

        if ros_client:
            st[key].close()
        if connect:
            st[key] = RosClient(ip, port)
            st[key].run(5)

        ros_client = st.get(key, None)
        is_connected = ros_client.is_connected if ros_client else False
        return (ros_client, is_connected)
# ---------- end ros ----------
robot = COMPASFABROSRobot(ros_client=ros.ros_client, load=Toggle(True))  # -> robot; inputs load: Boolean
#   port ros_client: The ROS client.
#   port load: If True, loads the robot from ROS. Defaults to False.
# ---------- robot: Python ----------
"""
Load robot directly from ROS.

COMPAS FAB v1.0.2
"""
from mobile_robot_control.mobile_robot import MobileRobot
from mobile_robot_control.mobile_robot_client import MobileRobotClient

from compas.scene import SceneObject
from ghpythonlib.componentbase import executingcomponent as component
from scriptcontext import sticky as st

from compas_fab.ghpython.components import create_id


class ROSRobot(component):
    def RunScript(self, ros_client, load):
        key = create_id(self, "robot")

        if ros_client and ros_client.is_connected and load:
            # Load URDF from ROS
            st[key] = ros_client.load_robot(load_geometry=True, precision=12)
            st[key].scene_object = SceneObject(st[key].model)
            mobile_robot = MobileRobot(st[key].model, st[key].scene_object, st[key].semantics, client=None)
            st[key] = mobile_robot
            
        mobile_robot = st.get(key, None)
        if mobile_robot:  # client sometimes need to be restarted, without needing to reload geometry
            mobile_robot.mobile_client = MobileRobotClient(ros_client)
            mobile_robot.client = ros_client
        return mobile_robot
# ---------- end robot ----------
robot_2 = Data(robot)
info = PythonScript(robot=robot_2)  # -> out, main_group_name
# ---------- info: Python ----------
if robot:
    robot.info()
    main_group_name = robot.main_group_name
# ---------- end info ----------
panel_5 = Panel(info.out)

simplified_gripper_mesh = Mesh(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)
pt = Point(Point(-2.401017388e-11, -1.002982373e-11, 0.09356287867))
detailed_gripper_mesh = Mesh(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)
xy = XYPlane(Origin=pt)

pt_2 = Point(Point(-2.401017388e-11, -1.002982373e-11, 0.14923472))
simplified_mtip = Mesh(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)
detailed_mtip = Mesh(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)
xy_2 = XYPlane(Origin=pt_2)

# ----
# 2) Attach tool and Collision Meshes
# Attach Tool
value_list = ValueList({"gripper", "measuring_tool"}, selected="measuring_tool")
select_tool = GhPythonScript(
    tool=value_list,
    visual_mesh_gripper=detailed_gripper_mesh,
    collision_mesh_gripper=simplified_gripper_mesh,
    tcf_plane_gripper=xy,
    visual_mesh_mtip=detailed_mtip,
    collision_mesh_mtip=simplified_mtip,
    tcf_plane_mtip=xy_2)  # -> visual_mesh, collision_mesh, tcf_plane; inputs visual_mesh_gripper: Mesh, collision_mesh_gripper: Mesh, tcf_plane_gripper: Plane, visual_mesh_mtip: Mesh, collision_mesh_mtip: Mesh
# ---------- select_tool: Python ----------
if tool == "gripper":
    
    visual_mesh = visual_mesh_gripper
    collision_mesh = collision_mesh_gripper
    tcf_plane = tcf_plane_gripper
    
elif tool== "measuring_tool":
    
    visual_mesh = visual_mesh_mtip
    collision_mesh = collision_mesh_mtip
    tcf_plane = tcf_plane_mtip
# ---------- end select_tool ----------
list = ValueList({"ur10e", "ur10e_and_liftkit"}, selected="ur10e")
tool = COMPASFABAttachedTool(
    robot=robot_2,
    visual_mesh=select_tool.visual_mesh,
    collision_mesh=select_tool.collision_mesh,
    tcf_plane=select_tool.tcf_plane,
    group=list)  # -> robot; inputs visual_mesh: Mesh, collision_mesh: Mesh
#   port visual_mesh: A visual mesh for the tool.
#   port collision_mesh: A collision mesh for the tool.
#   port tcf_plane: The frame of the tool in tool0 frame.
#   port group: The planning group to which the tool should be attached.
#   port connected_to: The link to which the tool should be connected to.
# ---------- tool: Python ----------
"""
Attach a tool to the robot.

COMPAS FAB v1.0.2
"""

from compas.geometry import Frame
from compas_rhino.conversions import mesh_to_compas
from compas_rhino.conversions import plane_to_compas_frame
from ghpythonlib.componentbase import executingcomponent as component

from compas_fab.robots import Tool


class AttachToolComponent(component):
    def RunScript(self, robot, visual_mesh, collision_mesh, tcf_plane, group, connected_to):
        if robot and robot.client and robot.client.is_connected and visual_mesh:
            if not collision_mesh:
                collision_mesh = visual_mesh

            c_visual_mesh = mesh_to_compas(visual_mesh)
            c_collision_mesh = mesh_to_compas(collision_mesh)

            if not tcf_plane:
                frame = Frame.worldXY()
            else:
                frame = plane_to_compas_frame(tcf_plane)
            tool = Tool(c_visual_mesh, frame, c_collision_mesh, connected_to=connected_to)

            robot.attach_tool(tool, group)

        return robot
# ---------- end tool ----------
robot_3 = Data(tool)

# ----
# Add New Markers to the Scene
# Point in WCF from Current Config
button = Button()
# MEASURING IN NEW MARKERS
get_config = GhPythonScript(robot=robot_3, group=list, send=button)  # -> config, frame_WCF, point
# ---------- get_config: Python ----------
import os
from scriptcontext import sticky as st
#sticky is a persistent dictionary which can save values and also be acessed by other GH components
#we use it here with a custom key to store values we read from the robot
from compas.rpc import Proxy
from compas.geometry import Frame
package_path = ghdoc.Path

config_key = 'config_{}'.format(str(ghenv.Component.InstanceGuid))
new_key = 'new_key_{}'.format(str(ghenv.Component.InstanceGuid))
frame_key = 'frame_{}'.format(str(ghenv.Component.InstanceGuid))

if config_key not in st:
    st[config_key] = None

if frame_key not in st:
    st[frame_key] = None

if send:
    canvas = ghenv.Component.OnPingDocument()
    path = os.path.abspath(os.path.join(package_path,"../robot"))
    print (path)
    rtde = Proxy('fabrication', path=path)
    
    st[config_key] = rtde.get_config(ip=ip)
    st[new_key] = rtde.get_config(ip=ip)
    st[frame_key] = robot.forward_kinematics(st[config_key], group, options=dict(solver='model'))
#    a = rtde.get_config(ip=ip)

config = st[config_key]
frame_RCF = st[frame_key]

#print "joint values: ", config.joint_values

if robot:
    frame_WCF = frame_RCF.transformed(robot.transformation_BCF_WCF())
    point = frame_WCF.Origin
# ---------- end get_config ----------
draw = Draw(cg=get_config.frame_WCF)  # -> rg
#   port cg: The COMPAS geometry or datastructure to be drawn.
#   port rg: The Rhino geometry object.
# ---------- draw: Python ----------
"""
Draws COMPAS geometry in Grasshopper.
"""
from ghpythonlib.componentbase import executingcomponent as component

from compas_rhino.conversions import frame_to_rhino_plane


class CompasToRhinoGeometry(component):
    def RunScript(self, cg):
        if not cg:
            return None

        return frame_to_rhino_plane(cg)
# ---------- end draw ----------
point = Point(get_config.point)

# ----
# 4) Set lift height
l = Slider(0, range=0..0.72)
set_lift = PythonScript(robot=robot_3, lift=l)  # -> bang
# ---------- set_lift: Python ----------
if robot:
    robot.lift_height = lift
    print(robot.RCF)
# ---------- end set_lift ----------

# ----
# Attach Collision Meshes to Base link
panel_6 = Panel("""PickUpStation1
PickUpStation2""")
pickupstation = Geometry([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])
robot_base_pu = Geometry(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)
mesh = Mesh(pickupstation)
attach_acm_to_baselink = GhPythonScript(robot=robot_3, meshes=mesh, names=panel_6)  # inputs meshes: list of Mesh, names: list
# ---------- attach_acm_to_baselink: Python ----------
from compas_fab.robots import PlanningScene
from compas_fab.robots import  CollisionMesh, AttachedCollisionMesh
from compas_rhino.conversions import mesh_to_compas


if robot:
    scene = PlanningScene(robot)
    
    i = 0
    for m in meshes:
        
        scene.remove_collision_mesh(names[i])
        scene.remove_attached_collision_mesh(names[i])
        
        scene.remove_collision_mesh("table")
        scene.remove_attached_collision_mesh("table")
        
        
        mesh = mesh_to_compas(m)
        cm = CollisionMesh(mesh, names[i])
        acm = AttachedCollisionMesh(cm, "base_link_inertia", ["base_link","base_link_inertia"] )
        scene.add_attached_collision_mesh(acm)
        
        i+=1
# ---------- end attach_acm_to_baselink ----------

# ----
# 2. Get base frame to a fixed marker
marker_id = Slider(2, range=0..59)
robot_4 = Data(robot)
unsubscribe = Button()
subscribe = Button()
export = Button()
clean = Button()
print = Button()
data = GhPythonScript()  # -> PATH
# ---------- data: Python ----------
import os
import ghpythonlib.components as ghcomp
import time

ghComp = ghenv.Component
ghDoc = ghComp.OnPingDocument()

# the full path of the gh file
path_gh_file = ghDoc.FilePath

# the directory of the gh file
HERE = os.path.dirname(path_gh_file)
DATA = os.path.join(HERE, '..', 'data', 'marker_frames')
PATH = os.path.join(DATA, 'markers.json')

print(PATH)
# ---------- end data ----------
get_tf_marker_frame = GhPythonScript(
    robot=robot_4,
    target_frame_id=marker_id,
    subscribe=subscribe,
    unsubscribe=unsubscribe,
    clean_all=clean,
    print=print,
    PATH=data,
    export=export)  # -> out, bang, target_frame_id, dict; inputs target_frame_id: Int32
# ---------- get_tf_marker_frame: Python ----------
from compas.geometry import Point, Quaternion, Frame, Vector
import json

reference_frame = "base"

target_frame = "marker_" + str(target_frame_id)

if subscribe:
    robot.mobile_client.marker_subscribe(target_frame, reference_frame)

if unsubscribe:
    robot.mobile_client.marker_unsubscribe(target_frame, reference_frame)

if export:
    with open(PATH, "w") as outfile:
        marker_data = {}
        for pose, markers in robot.mobile_client.marker_frames.items():
            marker_data[pose] = {}
            for marker, frame in markers.items():
                marker_data[pose][marker] = frame.to_data()
        json.dump(marker_data, outfile)

if clean_all:
    robot.mobile_client.marker_frames = {}

dict = robot.mobile_client.marker_frames
    
print "tf_clients: ", robot.mobile_client.tf_clients
print robot.mobile_client.marker_frames

if robot.mobile_client.marker_frames.get(target_frame):
    try:
        robot.mobile_client.marker_unsubscribe(target_frame, reference_frame)
    except:
        pass
# ---------- end get_tf_marker_frame ----------
visualise_markers = GhPythonScript(robot=robot_4, redraw=get_tf_marker_frame.bang)  # -> out, markers; inputs redraw: list
# ---------- visualise_markers: Python ----------
from scriptcontext import sticky as st
from compas.geometry import Frame, Point, Vector, Rotation
from compas_ghpython import draw_frame
import math

markers = []
for marker, frame in robot.mobile_client.marker_frames.items():
    #markers.append(draw_frame(frame)) # without BCF transformation
    markers.append(draw_frame(frame.transformed(robot.transformation_RCF_BCF())))
print(markers)
# ---------- end visualise_markers ----------
rec = DataRecorder(get_tf_marker_frame.out, DataLimit=-10, RecordData=True)
panel_7 = Panel(rec)
pln = Plane(visualise_markers.markers)
base_pose0_aa_robot = Plane(Plane(origin=(-0.2882979195, 1.402597494, 0.01635563836), x=(0.873153503, 0.4874453407, 0), y=(-0.4874453407, 0.873153503, 0)))

# ----
# Markers position AR app
geo = Geometry([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])
listdexs = ListIndices(List=geo)

# ----
# 1. Define the Markers' Frames
cluster = Cluster(A=aruco_marker_size, B=gutter, geometry=geo)  # -> geometry_2, centroid
xy_3 = XYPlane(Origin=cluster.geometry_2)
cluster_2 = Cluster_2(x_size=aruco_marker_size, target=xy_3, y_size=aruco_marker_size)  # -> centroid, geometry
xy_4 = XYPlane(Origin=cluster.centroid)
marker_dict = GhPythonScript(planes=cluster.geometry_2)  # -> out, fixed_marker_planes; inputs planes: list of Plane
# ---------- marker_dict: Python ----------
import Rhino.Geometry as rg

fixed_marker_planes ={}

for i, plane in enumerate (planes):
    fixed_marker_planes["marker_" + i.ToString()] = plane
    

fixed_marker_planes =[fixed_marker_planes]
# ---------- end marker_dict ----------

# ----
# Upload QRFrames to Project
floor_qr = Plane(xy_4)
merge = Merge(Data1=floor_qr, Data2=plane)  # -> flatten(Result)
compas = GhPythonScript(planes=merge)  # -> frames; inputs planes: list
# ---------- compas: Python ----------
from compas_rhino.conversions import plane_to_compas_frame

frames = []

for plane in planes:
    frames.append(plane_to_compas_frame(plane))
# ---------- end compas ----------

tag = TextTag(Location=cluster.centroid, Text=listdexs)

# ----
# Aruco Markers Positions
geo_2 = Geometry(cluster_2.geometry)
listdexs_2 = ListIndices(List=geo_2)
tag_2 = TextTag(Location=cluster_2.centroid, Text=listdexs_2)

regenerate_base_frame = GhPythonScript(robot=robot_4, fix_to_marker_id=get_tf_marker_frame.target_frame_id, fixed_marker_planes=marker_dict.fixed_marker_planes)  # -> out, base_plane, fixed_marker_plane; inputs fix_to_marker_id: Int32
# ---------- regenerate_base_frame: Python ----------
from scriptcontext import sticky as st
from compas.geometry import Transformation, Frame, Point
from compas_rhino.conversions import frame_to_rhino_plane

fix_to_marker = "marker_"+str(fix_to_marker_id)
print fix_to_marker
fixed_marker_plane = fixed_marker_planes[fix_to_marker]
#fixed_marker_plane = fixed_marker_0_plane
fixed_marker_frame = Frame(fixed_marker_plane.Origin, fixed_marker_plane.XAxis, fixed_marker_plane.YAxis)

if robot.mobile_client.marker_frames.get(fix_to_marker):
    marker_pose = robot.mobile_client.marker_frames[fix_to_marker]
    
    MCF_in_RCF = marker_pose #measured MCF in RCF 
    MCF_in_BCF = MCF_in_RCF.transformed(robot.transformation_RCF_BCF()) #measured MCF in BCF
        
    BCF_in_MCF = Frame.from_transformation(Transformation.from_frame(MCF_in_BCF).inverted()) #BCF in measured MCF
        
    transformation_FMCF_WCF = Transformation.from_change_of_basis(fixed_marker_frame, Frame.worldXY()) #T from fixed MCF to WCF
    BCF_in_WCF = BCF_in_MCF.transformed(transformation_FMCF_WCF) #BCF in WCF
        
    print BCF_in_WCF
        
    #mean_base_frame = ...
    robot.BCF = BCF_in_WCF
    base_frame = BCF_in_WCF
    base_plane = frame_to_rhino_plane(BCF_in_WCF)
# ---------- end regenerate_base_frame ----------

python_2 = GhPythonScript(qr_frames=compas, upload=Button())  # inputs qr_frames: list
# ---------- python_2: Python ----------
from compas_xr.project import ProjectManager

if not(config_filepath):
    ghenv.Component.Message = "Missing a Config"

elif not(qr_frames):
    ghenv.Component.Message = "Missing a QRFrames"

else:
    ghenv.Component.Message = None
    pm = ProjectManager(config_filepath)

    if upload:
        pm.upload_qr_frames_to_project(project_name, qr_frames)
# ---------- end python_2 ----------

# ----
# Aruco Markers Detection
base_pose0_ab_robot = Plane(Plane(origin=(-0.6434444802, -0.6813781601, 0.006533073321), x=(-0.4882225504, 0.8727191652, 0), y=(-0.8727191652, -0.4882225504, 0)))
base_plane_2 = Data(regenerate_base_frame.base_plane)

# ----
# 3) Move mobile cart base
set_to_world_origin = BooleanToggle(False)
base_plane_3 = Data(base_pose0_ab_robot)
set_base_frame = PythonScript(robot=robot_3, set_to_origin=set_to_world_origin, base_plane=base_plane_3)  # -> bang
# ---------- set_base_frame: Python ----------
from compas_ghpython import draw_frame
from compas.geometry import Frame, Point, Vector, Transformation
from compas.datastructures import Mesh
from compas_fab.robots import CollisionMesh

if set_to_origin:
    base_frame = Frame.worldXY()
else:
    base_frame = Frame(base_plane.Origin, base_plane.XAxis, base_plane.YAxis)

# Base_frame is BCF in WCF
if robot:
    robot.BCF = base_frame
# ---------- end set_base_frame ----------

# ----
# ROBOT VISUALIZATION
get_config_2 = GhPythonScript(robot=robot_3, group=list, send=set_base_frame)  # -> config
# ---------- get_config_2: Python ----------
import os
from scriptcontext import sticky as st
#sticky is a persistent dictionary which can save values and also be acessed by other GH components
#we use it here with a custom key to store values we read from the robot
from compas.rpc import Proxy
from compas.geometry import Frame
package_path = ghdoc.Path

config_key = 'config_{}'.format(str(ghenv.Component.InstanceGuid))

if config_key not in st:
    st[config_key] = None

if send:
    canvas = ghenv.Component.OnPingDocument()
    path = os.path.abspath(os.path.join(package_path,"../robot"))
    print (path)
    rtde = Proxy('fabrication', path=path)
    
    st[config_key] = rtde.get_config(ip=ip)


config = st[config_key]
# ---------- end get_config_2 ----------

list_2 = ValueList({"ur10e", "ur10e_and_liftkit"}, selected="ur10e")
robot_visualize = COMPASFABRobotVisualize(
    robot=robot_3,
    group=list_2,
    configuration=get_config_2,
    show_visual=Toggle(True),
    show_collision=Toggle(True),
    show_frames=Toggle(True),
    show_base_frame=Toggle(True),
    show_robot_frame=Toggle(True),
    show_end_effector_frame=Toggle(False),
    show_cm=Toggle(True),
    show_acm=Toggle(True),
    show_robot_reach=Toggle(True),
    redraw=Button())  # -> visual, collision, collision_meshes, attached_meshes, frames, base_frame, robot_frame, ee_frame, robot_reach; inputs show_visual: Boolean, show_collision: Boolean, show_frames: Boolean, show_base_frame: Boolean, show_end_effector_frame: Boolean, show_cm: Boolean, show_acm: Boolean
#   port group: The planning group used for end-effector and base visualization.
#   port configuration: The robot's full configuration.
#   port show_visual: Whether or not to show the robot's visual meshes.
#   port show_collision: Whether or not to show the robot's collision meshes.
#   port show_frames: Whether or not to show the robot's joint frames.
#   port show_base_frame: Whether or not to show the robot's base frame.
#   port show_end_effector_frame: Whether or not to show the robot's end-effector frame.
#   port show_cm: Whether or not to show the collision meshes (if any).
#   port show_acm: Whether or not to show the attached collision meshes (if any).
#   port visual: Rhino meshes of the robot's visual geometry (if any).
#   port collision: Rhino meshes of the robot's collision geometry (if any).
#   port collision_meshes: Rhino meshes of the scene's collision meshes (if any).
#   port attached_meshes: Rhino meshes of the scene's attached collision meshes (if any).
#   port frames: The robot's joint frames as Rhino planes (if any).
#   port base_frame: The robot's base frame as a Rhino plane (if any).
#   port ee_frame: The robot's end-effector frame as a Rhino plane (if any).
# ---------- robot_visualize: Python ----------
"""
Visualizes the robot.

COMPAS FAB v1.0.2
"""

import time
import Rhino.Geometry as rg 
import ghpythonlib.components as ghcomp
from compas.geometry import Frame
from compas.geometry import Transformation
from compas.geometry import Sphere
from compas.scene import SceneObject
from compas_ghpython import create_id
from compas_rhino.conversions import frame_to_rhino_plane, sphere_to_rhino
from ghpythonlib.componentbase import executingcomponent as component
from scriptcontext import sticky as st

from compas_fab.backends import BackendFeatureNotSupportedError
from compas_fab.robots import PlanningScene


class RobotVisualize(component):
    def RunScript(
        self,
        robot,
        group,
        configuration,
        show_visual,
        show_collision,
        show_frames,
        show_base_frame,
        show_robot_frame,
        show_end_effector_frame,
        show_cm,
        show_acm,
        show_robot_reach,
        redraw
    ):
        visual = None
        collision = None
        collision_meshes = None
        attached_meshes = None
        frames = None
        base_frame = None
        ee_frame = None
        robot_reach = None

        if robot:
            show_visual = True if show_visual is None else show_visual
            show_cm = True if show_cm is None else show_cm
            show_acm = True if show_acm is None else show_acm
            configuration = configuration or robot.zero_configuration()

            robot.update(configuration, visual=show_visual, collision=show_collision)
            compas_frames = robot.transformed_frames(configuration, group)

            if show_visual:
                visual = robot.scene_object.draw_visual()

            if show_visual:
                visual = robot.scene_object.draw_visual()
                # orient the robot to its base plane:
                robot_BCF = frame_to_rhino_plane(robot.BCF) 
                init_robot_plane = rg.Plane.WorldXY
                visual = ghcomp.Orient(visual, init_robot_plane, robot_BCF)[0]
                picking_frame = robot.to_world_coordinates(robot.PCF)
                
            if show_collision:
                collision = robot.scene_object.draw_collision()

            if show_base_frame:
                base_frame = compas_frames[0]
                base_frame = robot.BCF
                
            if show_robot_frame:
                base_frame = robot.RCF

            if show_end_effector_frame:
                options = dict(solver="model")
                if robot.attached_tool:
                    options["link"] = robot.attached_tool.connected_to

                ee_compas_frame = robot.forward_kinematics(configuration, group, options=options)
                ee_frame = frame_to_rhino_plane(ee_compas_frame)

            if show_frames:
                frames = []
                for compas_frame in compas_frames[1:]:
                    frame = frame_to_rhino_plane(compas_frame)
                    frames.append(frame)

            cached_scene_key = create_id(self, "cached_scene")
            
            if show_robot_reach:
                base_frame = compas_frames[0]
                geo_origin = Frame([base_frame.point.x, base_frame.point.y, base_frame.point.z+0.152], base_frame.xaxis, base_frame.yaxis)
                geo = Sphere.from_point_and_radius(geo_origin.point, 0.5)
                robot_reach = sphere_to_rhino(geo)

            if show_cm or show_acm:
                cached_scene = st.get(cached_scene_key)
                if not cached_scene:
                    cached_scene = {"time": 0}

                # expire cache if the component has not been executhe last 2 seconds
                # this allows to slide through a list of configurations
                # without triggering refreshes of the scene in the middle of it
                if time.time() - cached_scene["time"] > 2:
                    update_scene = True
                else:
                    update_scene = False

                if update_scene:
                    scene = PlanningScene(robot)
                    try:
                        scene = robot.client.get_planning_scene()
                    except BackendFeatureNotSupportedError:
                        print(
                            "The selected backend does not support collision meshes. If you need collision mesh support, use a different backend."
                        )
                        scene = None
                        show_cm = False
                        show_acm = False

                if update_scene and show_cm:
                    collision_meshes = []
                    
                    print type (scene.world.collision_objects)
                    for co in scene.world.collision_objects:
                        header = co.header
                        frame_id = header.frame_id
                        cms = co.to_collision_meshes()

                        for cm in cms:
                            if cm.frame != Frame.worldXY():
                                t = Transformation.from_frame(cm.frame)
                                mesh = cm.mesh.transformed(t)
                            else:
                                mesh = cm.mesh
                            
                            collision_meshes.extend(SceneObject(mesh).draw())

                        cached_scene["cm"] = collision_meshes

                collision_meshes = cached_scene.get("cm", [])

                if update_scene and show_acm:
                    attached_meshes = []

                    for aco in scene.robot_state.attached_collision_objects:
                        for acm in aco.to_attached_collision_meshes():
                            frame_id = aco.object["header"]["frame_id"]
                            frame = robot.forward_kinematics(configuration, options=dict(link=frame_id))
                            t = Transformation.from_frame(frame)

                            # Local CM frame
                            if acm.collision_mesh.frame and acm.collision_mesh.frame != Frame.worldXY():
                                t = t * Transformation.from_frame(acm.collision_mesh.frame)

                            mesh = acm.collision_mesh.mesh.transformed(t)

                            attached_meshes.extend(SceneObject(mesh).draw())

                    cached_scene["acm"] = attached_meshes

                attached_meshes = cached_scene.get("acm", [])

                cached_scene["time"] = time.time()
                st[cached_scene_key] = cached_scene

        return (
            visual,
            collision,
            collision_meshes,
            attached_meshes,
            frames,
            base_frame,
            ee_frame,
            robot_reach,
        )
# ---------- end robot_visualize ----------

to_wcf = GhPythonScript(robot=robot_3, meshes=robot_visualize.attached_meshes)  # -> out, transformed_meshes; inputs meshes: list of Mesh
# ---------- to_wcf: Python ----------
import Rhino.Geometry as rg

matrix = robot.transformation_BCF_WCF().matrix
# Create a transformation object
T = rg.Transform()

T.M00= matrix[0][0]
T.M01= matrix[0][1]
T.M02= matrix[0][2]
T.M03= matrix[0][3]

T.M10= matrix[1][0]
T.M11= matrix[1][1]
T.M12= matrix[1][2]
T.M13= matrix[1][3]

T.M20= matrix[2][0]
T.M21= matrix[2][1]
T.M22= matrix[2][2]
T.M23= matrix[2][3]

T.M30= matrix[3][0]
T.M31= matrix[3][1]
T.M32= matrix[3][2]
T.M33= matrix[3][3]


# Apply transformation to your objects
transformed_meshes = []
for mesh in meshes:  
    transformed_mesh = mesh.Duplicate()  
    transformed_mesh.Transform(T) 
    transformed_meshes.append(transformed_mesh)
# ---------- end to_wcf ----------
mesh_2 = Mesh(robot_visualize.visual)

# ----
# Create BuildingPlan only
base = Geometry([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])
number_slider = Slider(141, range=1..141)

# ----
# Parts and frames
visualize_te_assembly = GhPythonScript(assembly=python.assembly_out)  # -> out, a, frames, assembly_frames, indexes
# ---------- visualize_te_assembly: Python ----------
from compas.geometry import Frame

a=[]
frames = []
assembly_frames = []
indexes = []
assembly_data = assembly.graph.__data__["node"]

for part in assembly.parts():
    a.append(part)
    frames.append(part.frame)

for key in range(len(assembly_data)):
    frame = assembly_data[str(key)]["part"].frame
    assembly_frames.append(frame)
    indexes.append(key)
# ---------- end visualize_te_assembly ----------
draw_2 = Draw(cg=visualize_te_assembly.a)  # -> flatten(rg)
#   port cg: The COMPAS geometry or datastructure to be drawn.
#   port rg: The Rhino geometry object.
# ---------- draw_2: Python ----------
"""
Draws COMPAS geometry in Grasshopper.
"""

from ghpythonlib.componentbase import executingcomponent as component

from compas.scene import SceneObject


class CompasToRhinoGeometry(component):
    def RunScript(self, cg):
        if not cg:
            return None

        return SceneObject(cg).draw()
# ---------- end draw_2 ----------
draw_3 = Draw(cg=visualize_te_assembly.assembly_frames)  # -> rg
#   port cg: The COMPAS geometry or datastructure to be drawn.
# ---------- draw_3: Python ----------
from compas_rhino.conversions import frame_to_rhino_plane

rg = frame_to_rhino_plane(cg)
# ---------- end draw_3 ----------

split_list = SplitList(List=draw_3, Index=number_slider)  # -> ListA, ListB
split_list_2 = SplitList(List=draw_2, Index=number_slider)  # -> ListA, ListB

points = PointList(Points=split_list.ListA, Size="0.04")

preview = CustomPreview(Geometry=[split_list_2.ListA, base], Material=ColourSwatch(SwatchColor=RGBA(156, 156, 156, 116)))

# ==== cluster Cluster
A = ClusterInput()
B = ClusterInput()
addition = Addition(A=A, B=B)
geometry = ClusterInput()
rectangle = Rectangle(Plane=PlaneXY(0, 0, 0), XSize=addition, YSize=addition, Radius=0)  # -> Rectangle, Length
area = Area(Geometry=geometry)  # -> Area, Centroid
centroid = ClusterOutput(area.Centroid)
area_2 = Area(Geometry=rectangle.Rectangle)  # -> Area, Centroid
orient = Orient(Geometry=rectangle.Rectangle, Source=area_2.Centroid, Target=area.Centroid)  # -> Geometry, Transform
control_points = ControlPoints(Curve=orient.Geometry)  # -> Points, Weights, Knots
cull_index = CullIndex(List=control_points.Points, Indices="-1", Wrap=True)
split_list = SplitList(List=cull_index, Index="2")  # -> ListA, ListB
reverse_list = ReverseList(List=split_list.ListB)
merge = Merge(Data1=reverse_list, Data2=split_list.ListA)  # -> flatten(Result)
xy_plane = XYPlane(Origin=merge)
flip_plane = FlipPlane(Plane=xy_plane, ReverseX=False, ReverseY=False, SwapAxes=True)
yz_plane = YZPlane(Origin=merge)
deconstruct_plane = DeconstructPlane(Plane=yz_plane)  # -> Origin, XAxis, YAxis, ZAxis
deconstruct_plane_2 = DeconstructPlane(Plane=yz_plane)  # -> Origin, XAxis, YAxis, ZAxis
rotate_3d = Rotate3D(Geometry=yz_plane, Angle=degrees("-90"), Center=deconstruct_plane.Origin, Axis=deconstruct_plane.ZAxis)  # -> Geometry, Transform
rotate_3d_2 = Rotate3D(Geometry=yz_plane, Angle=degrees("90"), Center=deconstruct_plane.Origin, Axis=deconstruct_plane.ZAxis)  # -> Geometry, Transform
rotate_3d_3 = Rotate3D(Geometry=yz_plane, Angle=degrees("90"), Center=deconstruct_plane_2.Origin, Axis=deconstruct_plane_2.ZAxis)  # -> Geometry, Transform
flip_plane_2 = FlipPlane(Plane=rotate_3d_2.Geometry, ReverseX=True, ReverseY=False, SwapAxes=True)
geometry_2 = ClusterOutput(rotate_3d_3.Geometry)

# ==== cluster Cluster_2
x_size = ClusterInput()
y_size = ClusterInput()
rectangle = Rectangle(Plane=PlaneXY(0, 0, 0), XSize=x_size, YSize=y_size, Radius=0)  # -> Rectangle, Length
area = Area(Geometry=rectangle.Rectangle)  # -> Area, Centroid
target = ClusterInput()
orient = Orient(Geometry=rectangle.Rectangle, Source=area.Centroid, Target=target)  # -> Geometry, Transform
area_2 = Area(Geometry=orient.Geometry)  # -> Area, Centroid
geometry = ClusterOutput(orient.Geometry)
centroid = ClusterOutput(area_2.Centroid)
